# Grasshopper definition comfort.gh (Grasshopper 1.0.7)

path = FilePath("F:\SEU\2026\simulation\CHN_Jiangsu.Nanjing.582380_CSWD\CHN_Jiangsu.Nanjing.582380_CSWD.epw")
brep = Brep([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])
surface = Surface(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)
genpts = LBGeneratePointGrid(geometry=surface, grid_size=Slider(5, range=0..10))  # -> points, vectors, face_areas, mesh; plug-in component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
path_2 = FilePath("F:\SEU\2026\simulation\CHN_Jiangsu.Nanjing.582380_CSWD\CHN_Jiangsu.Nanjing.582380_CSWD.epw")
# 空气温度等气象数据可视化
# 风玫瑰图
importepw = LBImportEPW(epw_file=path)  # -> location, dry_bulb_temperature, dew_point_temperature, relative_humidity, wind_speed, wind_direction, direct_normal_rad, diffuse_horizontal_rad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; plug-in component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

# ---- group: 计算人体辐射温度MRT
point = Point(Point(102, -194.8075489, 0))
brep_2 = Brep([<brep referenced from the Rhino model> x4])
humantosky = LBHumanToSkyRelation(
    location=importepw.location,
    position=flatten(point),
    context=flatten(brep_2),
    pt_count=Slider(2, range=0..10),
    height=Slider(1.6, range=0..10),
    run=Toggle(True))  # -> out, human_points, human_line, fract_body_exp, sky_exposure; plug-in component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
outdoorsolarmrt = LBOutdoorSolarMRT(
    location=importepw.location,
    surface_temp=importepw.dry_bulb_temperature,
    dir_norm_rad=importepw.direct_normal_rad,
    diff_horiz_rad=importepw.diffuse_horizontal_rad,
    horiz_infrared=importepw.horizontal_infrared_rad,
    fract_body_exp=humantosky.fract_body_exp,
    sky_exposure=humantosky.sky_exposure,
    run=Toggle(True))  # -> out, short_erf, long_erf, short_dmrt, long_dmrt, mrt; plug-in component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

# ----
importepw_2 = LBImportEPW(epw_file=path_2)  # -> location, dry_bulb_temperature, dew_point_temperature, relative_humidity, wind_speed, wind_direction, direct_normal_rad, diffuse_horizontal_rad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; plug-in component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
humantosky_2 = LBHumanToSkyRelation(
    location=importepw_2.location,
    position=flatten(genpts.points),
    context=flatten(brep),
    pt_count=Slider(2, range=0..10),
    height=Slider(1.6, range=0..10),
    run=Toggle(True))  # -> out, human_points, human_line, fract_body_exp, sky_exposure; plug-in component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
analysisperiod = LBAnalysisPeriod(
    start_month=Slider(6, range=0..10),
    start_day=Slider(12, range=0..100),
    start_hour=0,
    end_month=Slider(9, range=0..10),
    end_day=Slider(6, range=0..100))  # -> period, hoys, dates; plug-in component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
analysisperiod_2 = LBAnalysisPeriod(start_month=1, start_day=1, start_hour=0)  # -> period, hoys, dates; plug-in component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
applyper = LBApplyAnalysisPeriod(data=importepw_2.wind_speed, period=analysisperiod.period)  # -> data; plug-in component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
applyper_2 = LBApplyAnalysisPeriod(data=importepw_2.direct_normal_rad, period=analysisperiod.period)  # -> data; plug-in component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
applyper_3 = LBApplyAnalysisPeriod(data=importepw_2.horizontal_infrared_rad, period=analysisperiod.period)  # -> data; plug-in component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
applyper_4 = LBApplyAnalysisPeriod(data=importepw_2.relative_humidity, period=analysisperiod.period)  # -> data; plug-in component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
applyper_5 = LBApplyAnalysisPeriod(data=importepw_2.diffuse_horizontal_rad, period=analysisperiod.period)  # -> data; plug-in component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
applyper_6 = LBApplyAnalysisPeriod(data=importepw_2.dry_bulb_temperature, period=analysisperiod.period)  # -> data; plug-in component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
applyper_7 = LBApplyAnalysisPeriod(data=importepw.wind_speed, period=analysisperiod_2.period)  # -> data; plug-in component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
applyper_8 = LBApplyAnalysisPeriod(data=humantosky_2.fract_body_exp, period=analysisperiod.period)  # -> data; plug-in component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
outdoorsolarmrt_2 = LBOutdoorSolarMRT(
    location=importepw_2.location,
    surface_temp=applyper_6,
    dir_norm_rad=applyper_2,
    diff_horiz_rad=applyper_5,
    horiz_infrared=applyper_3,
    fract_body_exp=applyper_8,
    sky_exposure=humantosky_2.sky_exposure,
    run=Toggle(False))  # -> out, short_erf, long_erf, short_dmrt, long_dmrt, mrt; plug-in component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
utci = LBUTCIComfort(air_temp=applyper_6, mrt=outdoorsolarmrt_2.mrt, rel_humid=applyper_4, wind_vel=applyper, run=Toggle(False))  # -> out, utci, comfort, condition, category, comf_obj; plug-in component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
# 月度图
# 每个月的风玫瑰图
utci_2 = LBUTCIComfort(
    air_temp=importepw.dry_bulb_temperature,
    mrt=outdoorsolarmrt.mrt,
    rel_humid=importepw.relative_humidity,
    wind_vel=importepw.wind_speed,
    run=Toggle(True))  # -> out, utci, comfort, condition, category, comf_obj; plug-in component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
colrange = LBColorRange(index=Slider(0, range=0..10))  # -> colors; plug-in component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
xdata = LBDeconstructData(data=utci.utci)  # -> header, values; plug-in component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
legendpar = LBLegendParameters(text_height="4")  # -> leg_par; plug-in component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
comfstat = LBComfortStatistics(comf_obj=flatten(utci_2.comf_obj))  # -> pct_hot, pct_neutral, pct_cold; plug-in component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
legendpar_2 = LBLegendParameters(colors=colrange, text_height="4")  # -> leg_par; plug-in component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
mass_addition = MassAddition(Input=xdata.values)  # -> Result, PartialResults
list_length = ListLength(List=xdata.values)
point_2 = Point(Point(6, -241.8636934, 0))
panel = Panel(comfstat.pct_neutral)
hourlyplot = LBHourlyPlot(data=flatten(utci_2.utci), base_pt=point_2, legend_par=legendpar)  # -> report, mesh, legend, borders, labels, title, vis_set; plug-in component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
division = Division(A=mass_addition.Result, B=list_length)  # -> simplify(flatten(Result))
heatmap = LBSpatialHeatmap(values=simplify(division), mesh=simplify(genpts.mesh), legend_par=legendpar_2, legend_title="UTCI")  # -> mesh, legend, title, colors, legend_par, vis_set; plug-in component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
geo = Geometry([hourlyplot.mesh, hourlyplot.legend, hourlyplot.borders, hourlyplot.labels])
