# Grasshopper definition massing.gh (Grasshopper 1.0.7)

massing_index = GetInteger(Slider(0, range=0..10), AtLeast=1, AtMost=1, Maximum=2147483647, Minimum=-2147483648, TreeAccess=False)
x2_factor = Slider(0.38, range=0..1)
pos2 = Slider(0.73, range=0..1)
y2_factor = Slider(0.28, range=0..1)
y1_factor = Slider(0.27, range=0..1)
pos1 = Slider(0.53, range=0..1)
x1_factor = Slider(0.37, range=0..1)
y2_factor_2 = GetNumber(y2_factor, AtLeast=1, AtMost=1, Maximum=1.797693135e+308, Minimum=-1.797693135e+308, TreeAccess=False)
pos2_2 = GetNumber(pos2, AtLeast=1, AtMost=1, Maximum=1.797693135e+308, Minimum=-1.797693135e+308, TreeAccess=False)
x2_factor_2 = GetNumber(x2_factor, AtLeast=1, AtMost=1, Maximum=1.797693135e+308, Minimum=-1.797693135e+308, TreeAccess=False)
y1_fatcor = GetNumber(y1_factor, AtLeast=1, AtMost=1, Maximum=1.797693135e+308, Minimum=-1.797693135e+308, TreeAccess=False)
pos1_2 = GetNumber(pos1, AtLeast=1, AtMost=1, Maximum=1.797693135e+308, Minimum=-1.797693135e+308, TreeAccess=False)
building_area = GetInteger(Slider(8000, range=0..10000), AtLeast=1, AtMost=1, Maximum=2147483647, Minimum=-2147483648, TreeAccess=False)
size_y = GetNumber(Slider(60.4, range=0..100), AtLeast=1, AtMost=1, Maximum=1.797693135e+308, Minimum=-1.797693135e+308, TreeAccess=False)
x1_fatcor = GetNumber(x1_factor, AtLeast=1, AtMost=1, Maximum=1.797693135e+308, Minimum=-1.797693135e+308, TreeAccess=False)
floor_count = GetInteger(Slider(9, range=0..100), AtLeast=1, AtMost=1, Maximum=2147483647, Minimum=-2147483648, TreeAccess=False)
size_x = GetNumber(Slider(73.4, range=0..100), AtLeast=1, AtMost=1, Maximum=1.797693135e+308, Minimum=-1.797693135e+308, TreeAccess=False)
num = Number(y2_factor_2)
num_2 = Number(pos2_2)
num_3 = Number(size_x)
num_4 = Number(x2_factor_2)
num_5 = Number(size_y)
num_6 = Number(building_area)
num_7 = Number(pos1_2)
num_8 = Number(floor_count)
num_9 = Number(x1_fatcor)
num_10 = Number(y1_fatcor)
number_slider = Slider(0.32, range=0..1)
number_slider_2 = Slider(0.97, range=0..1)
floor = Slider(3, range=0..10)
multiplication = Multiplication(A=num_5, B=number_slider)
multiplication_2 = Multiplication(A=num_3, B=number_slider_2)
multiplication_3 = Multiplication(A=num_3, B=number_slider_2)
multiplication_4 = Multiplication(A=multiplication, B=-1)
multiplication_5 = Multiplication(A=num_5, B=number_slider)
pt = Point(Point(4.559784889, 35.58810806, -0.08981414884))
pt_2 = Point(Point(4.570452213, -27.17749977, -0.1358193904))
multiplication_6 = Multiplication(A=floor, B="4")
rectangle = Rectangle(Plane=pt, XSize=multiplication_2, YSize=multiplication_4, Radius=0)  # -> Rectangle, Length
multiplication_7 = Multiplication(A=num_8, B="4")
multiplication_8 = Multiplication(A=Slider(3, range=0..10), B="4")
Z = UnitZ(Factor=multiplication_6)
rectangle_2 = Rectangle(Plane=pt_2, XSize=multiplication_3, YSize=multiplication_5, Radius=0)  # -> Rectangle, Length
multiplication_9 = Multiplication(A=num_8, B="4")
Z_2 = UnitZ(Factor=multiplication_8)
explode = Explode(Curve=rectangle.Rectangle, Recursive=True)  # -> Segments, Vertices
move = Move(Geometry=rectangle.Rectangle, Motion=Z)  # -> Geometry, Transform
Z_3 = UnitZ(Factor=multiplication_7)
explode_2 = Explode(Curve=rectangle_2.Rectangle, Recursive=True)  # -> Segments, Vertices
move_2 = Move(Geometry=rectangle_2.Rectangle, Motion=Z_2)  # -> Geometry, Transform
Z_4 = UnitZ(Factor=multiplication_9)
loft = Loft(
    Curves=[rectangle.Rectangle, move.Geometry],
    Options={Adjust=False, Closed=False, LoftEnds=0, LoftSimp=0, LoftType=0, Rebuild=10, Refit=0.01})
item = ListItem(List=explode.Segments, Index=2, Wrap=True)
multiplication_10 = Multiplication(B=-1)
multiplication_11 = Multiplication(A=num_5, B=num)
loft_2 = Loft(
    Curves=[rectangle_2.Rectangle, move_2.Geometry],
    Options={Adjust=False, Closed=False, LoftEnds=0, LoftSimp=0, LoftType=0, Rebuild=10, Refit=0.01})
item_2 = ListItem(List=explode_2.Segments, Index=0, Wrap=True)
multiplication_12 = Multiplication(A=num_3, B=num_4)
multiplication_13 = Multiplication(A=num_3, B=num_9)
multiplication_14 = Multiplication(A=num_5, B=num_10)
eval = EvaluateCurve(Curve=reparameterize(item), Parameter=num_2)  # -> Point, Tangent, Angle
neg = Negative(Value=multiplication_11)
eval_2 = EvaluateCurve(Curve=reparameterize(item_2), Parameter=num_7)  # -> Point, Tangent, Angle
cap = CapHoles(Brep=loft_2)
rectangle_3 = Rectangle(Plane=eval_2.Point, XSize=multiplication_13, YSize=multiplication_14, Radius=0)  # -> Rectangle, Length
rectangle_4 = Rectangle(Plane=eval.Point, XSize=multiplication_12, YSize=neg, Radius=0)  # -> Rectangle, Length
area = Area(Geometry=rectangle_3.Rectangle)  # -> Area, Centroid
division = Division(A=num_6, B=area.Area)
move_3 = Move(Geometry=rectangle_4.Rectangle, Motion=Z_3)  # -> Geometry, Transform
move_4 = Move(Geometry=rectangle_3.Rectangle, Motion=Z_4)  # -> Geometry, Transform
round = Round(Number=division)  # -> Nearest, Floor, Ceiling
loft_3 = Loft(
    Curves=[rectangle_4.Rectangle, move_3.Geometry],
    Options={Adjust=False, Closed=False, LoftEnds=0, LoftSimp=0, LoftType=0, Rebuild=10, Refit=0.01})
loft_4 = Loft(
    Curves=[rectangle_3.Rectangle, move_4.Geometry],
    Options={Adjust=False, Closed=False, LoftEnds=0, LoftSimp=0, LoftType=0, Rebuild=10, Refit=0.01})
cap_2 = CapHoles(Brep=loft)
cap_3 = CapHoles(Brep=loft_3)
cap_4 = CapHoles(Brep=loft_4)
geo = Geometry(flatten([cap_4, cap, cap_3, cap_2]))
context_bake = ContextBake(Geometry=geo)
