# Grasshopper definition wind.gh (Grasshopper 1.0.7)
# plug-ins: Eddy3D

templates = Templates()

# ----
# https://energyplus-weather.s3.amazonaws.com/asia_wmo_region_2/CHN/CHN_Shanghai.Shanghai.583670_IWEC/CHN_Shanghai.Shanghai.583670_IWEC.zip
number_slider = Slider(3, range=0..10)  # disabled
number_slider_2 = Slider(45, range=0..100)  # disabled
brep = Brep(flatten([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]))  # disabled
brep_2 = Brep(<brep referenced from the Rhino model>)  # disabled
abl = ABL(
    WindDirections=number_slider_2,
    ReferenceVelocityAtZref_m_s=number_slider,
    ReferenceHeight_m=10,
    SurfaceRoughnessHeight_m=1,
    MinimumZCoordinate_m=0)  # disabled
mesh = Mesh(brep)  # disabled
geometry = Geometry(brep_2)  # disabled
mesh_join = MeshJoin(Meshes=mesh)  # disabled

# ----
# 风速风向
# EPW文件地址
# https://energyplus-weather.s3.amazonaws.com/asia_wmo_region_2/CHN/CHN_Shanghai.Shanghai.583670_IWEC/CHN_Shanghai.Shanghai.583670_IWEC.zip
number_slider_3 = Slider(3, range=0..10)

epwmap = LBEPWmap(epw_map=Toggle(False))  # -> Output; plug-in component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

# ----
# 分析体块
brep_3 = Brep(flatten([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]))

abl_2 = ABL(
    WindDirections=Slider(45, range=0..100),
    ReferenceVelocityAtZref_m_s=number_slider_3,
    ReferenceHeight_m=10,
    SurfaceRoughnessHeight_m=1,
    MinimumZCoordinate_m=0)
mesh_2 = Mesh(brep_3)
mesh_join_2 = MeshJoin(Meshes=mesh_2)
box_shaped_domain = BoxShapedDomain(Geometry=mesh_join_2, BoundaryCondition=abl_2, BlockSize=20)  # -> Domain, Mesh
box_shaped_domain_2 = BoxShapedDomain(Geometry=mesh_join, Terrain=geometry, BoundaryCondition=abl, BlockSize=20)  # -> Domain, Mesh; disabled
panel = Panel("C:\3_SimpleWindAnalysiss")
number_slider_4 = Slider(40, range=0..100)  # disabled
button = Button()  # disabled
button_2 = Button()
run_settings = RunSettings(
    NumberOfIterations=Slider(60, range=0..100),
    WriteInterval=20,
    NumberOfTimestepsToKeep=3,
    TurbulenceModel=1,
    RelaxationFactors=3,
    SolutionAndAlgorithmControl=1,
    PotentialFoamInitialization=False,
    AgeOfAir=False,
    NumberOfCPUs="-1",
    OperatingSystem=0)
mesh_settings = MeshSettings(AccBuilding=2, AccFeatures="3", AccBBox=0, AccGround="3", MiscSettings=1, NumberOfLayers=4, Mode=2)
simulation = Simulation(
    SimulationDomain=box_shaped_domain.Domain,
    WorkingDirectory=panel,
    MeshSettings=mesh_settings,
    RunSettings=run_settings,
    RunMeshing=button_2,
    MakeTrees=False,
    RunSimulation=button_2,
    runWithBlueCFD=True)
visualize_residuals = Residuals(Result=simulation, X=":", Y=":", Version=1, Run=button, visResiduals=True)  # disabled
number_slider_5 = Slider(2, range=0..10)  # disabled

# ----
# 分析面
surface = Surface(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)

genpts = LBGeneratePointGrid(geometry=surface, grid_size=Slider(2, range=0..10))  # -> points, vectors, face_areas, mesh; plug-in component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
surface_2 = Surface(<surface referenced from the Rhino model>)  # disabled
genpts_2 = LBGeneratePointGrid(geometry=surface_2, grid_size=number_slider_5)  # -> points, vectors, face_areas, mesh; disabled; plug-in component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
visprobes = VisualizeProbes(Result=simulation, ProbingPoints=genpts.points, NameOfInstance="ttt", NameOfField=0, Run=Button())  # -> PorbingPoints, ProbingResult

# ----
# Clean
button_3 = Button()
clean = Clean(Directory=panel, Mode=2, Run=button_3)

points = Data(visprobes.PorbingPoints)
vectors = Data(visprobes.ProbingResult)

# ----
# 此处为数值筛选 大于2.2米每秒 替换为2.3等 按实际结果替换
number_slider_6 = Slider(15, range=0..15)
sort_list = SortList(Keys=vectors)  # -> Keys, ValuesValuesA
larger_than = LargerThan(FirstNumber=vectors, SecondNumber=number_slider_6)  # -> LargerThan, OrEqualTo
panel_2 = Panel(sort_list.Keys)
dispatch = Dispatch(List=vectors, DispatchPattern=larger_than.LargerThan)  # -> ListA, ListB
item_index = ItemIndex(List=vectors, Item=dispatch.ListA)
replace_items = ReplaceItems(List=vectors, Item=Slider(15, range=0..15), Indices=item_index, Wrap=False)
panel_3 = Panel(replace_items)
heatmap = LBSpatialHeatmap(values=replace_items, mesh=genpts.mesh, legend_title="m/s", global_title="风速")  # -> mesh, legend, title, colors, legend_par, vis_set; plug-in component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

# ----
# Paraview
button_4 = Button()
open_paraview = Paraview(Result=simulation, ParaviewVersion=2, Run=button_4)

panel_4 = Panel(vectors)
data = Data(replace_items)
bnd = Bounds(Numbers=data)
dedomain = DeconstructDomain(Domain=bnd)  # -> Start, End
gradient = Gradient(
    LowerLimit=dedomain.Start,
    UpperLimit=dedomain.End,
    Parameter=data,
    stops=[0.103: RGB(0, 0, 255), 0.22: RGB(0, 170, 255), 0.305: RGB(0, 255, 255), 0.398: RGB(0, 255, 188), 0.504: RGB(0, 255, 106), 0.605: RGB(91, 255, 0), 0.699: RGB(184, 255, 0), 0.799: RGB(255, 255, 0), 0.898: RGB(255, 170, 0)])

# ----
# 风向
vector_display_ex = VectorDisplayEx(Point=points, Vector=vectors, Colour=gradient, Width=Slider(1, range=0..10))

area = Area(Geometry=surface)  # -> Area, Centroid
pt = Point(area.Centroid)
Z = UnitZ(Factor=Slider(8460, range=0..10000))
path = FilePath("F:\SEU\2026\simulation\compute_simulation\grasshopper\wind.png")
move = Move(Geometry=pt, Motion=Z)  # -> Geometry, Transform
geo = Geometry(heatmap.mesh)
geo_2 = Geometry(heatmap.legend)
panel_5 = Panel(path)
c_script = CSharpScript(
    on=Toggle(True),
    CameraLocation=move.Geometry,
    CameraTarget=pt,
    len=Slider(91, range=0..100),
    shoot=Toggle(True),
    file=path)  # -> out, A; inputs on: Boolean, CameraLocation: Point3d, CameraTarget: Point3d, len: Double, bias: Double, shoot: Boolean, file: String
# ---------- c_script: C# usings ----------
using System.Drawing;
# ---------- c_script: C# ----------
    Point3d cL = CameraLocation;
    Point3d cT = CameraTarget;
    if(on)
    {
      Rhino.Display.RhinoViewport v = RhinoDoc.ActiveDoc.Views.ActiveView.ActiveViewport;
      Vector3d vec = cT - cL;
      v.SetCameraDirection(vec, true);
      v.Camera35mmLensLength = len;
      v.Rotate(bias / 180 * Math.PI, v.CameraZ, v.CameraLocation);
      Vector3d cz = v.CameraZ;
      A = cz;
      if(shoot)
      {
        Rhino.RhinoDoc.ActiveDoc.Views.ActiveView.CaptureToBitmap(new Size(1920, 1080)).Save(file);
      }
    }
# ---------- end c_script ----------

panel_6 = Panel("C:\3_SimpleWindAnalysis")  # disabled
button_5 = Button()  # disabled
panel_7 = Panel("3")  # disabled
panel_8 = Panel("-1")  # disabled
button_6 = Button()  # disabled
run_settings_2 = RunSettings(
    NumberOfIterations=number_slider_4,
    WriteInterval=20,
    NumberOfTimestepsToKeep=3,
    TurbulenceModel=1,
    RelaxationFactors=3,
    SolutionAndAlgorithmControl=1,
    PotentialFoamInitialization=False,
    AgeOfAir=False,
    NumberOfCPUs=panel_8,
    OperatingSystem=0)  # disabled

mesh_settings_2 = MeshSettings(AccBuilding=2, AccFeatures=panel_7, AccBBox=0, AccGround=panel_7, MiscSettings=1, NumberOfLayers=4, Mode=2)  # disabled

simulation_2 = Simulation(
    SimulationDomain=box_shaped_domain_2.Domain,
    WorkingDirectory=panel_6,
    MeshSettings=mesh_settings_2,
    RunSettings=run_settings_2,
    RunMeshing=button_6,
    MakeTrees=False,
    RunSimulation=button_6,
    runWithBlueCFD=True)  # disabled
visualize_residuals_2 = Residuals(Result=simulation_2, X=":", Y=":", Version=1, Run=button_5, visResiduals=True)  # disabled

button_7 = Button()  # disabled
panel_9 = Panel("ttt")  # disabled
visprobes_2 = VisualizeProbes(Result=simulation_2, ProbingPoints=genpts_2.points, NameOfInstance=panel_9, NameOfField=0, Run=button_7)  # -> PorbingPoints, ProbingResult; disabled

# ----
# Clean
button_8 = Button()  # disabled
clean_2 = Clean(Directory=panel_6, Mode=2, Run=button_8)  # disabled

number_slider_7 = Slider(4.9, range=0..10)  # disabled
number_slider_8 = Slider(5, range=0..10)  # disabled
panel_10 = Panel("风速")  # disabled
panel_11 = Panel("m/s")  # disabled

# ----
# Paraview
# Wind vectors
points_2 = Data(visprobes_2.PorbingPoints)  # disabled
vectors_2 = Data(visprobes_2.ProbingResult)  # disabled
button_9 = Button()  # disabled
open_paraview_2 = Paraview(Result=simulation_2, ParaviewVersion=2, Run=button_9)  # disabled
number_slider_9 = Slider(3, range=0..10)  # disabled

larger_than_2 = LargerThan(FirstNumber=vectors_2, SecondNumber=number_slider_7)  # -> LargerThan, OrEqualTo; disabled
sort_list_2 = SortList(Keys=vectors_2)  # -> Keys, ValuesValuesA; disabled
panel_12 = Panel(sort_list_2.Keys)  # disabled
dispatch_2 = Dispatch(List=vectors_2, DispatchPattern=larger_than_2.LargerThan)  # -> ListA, ListB; disabled
item_index_2 = ItemIndex(List=vectors_2, Item=dispatch_2.ListA)  # disabled
replace_items_2 = ReplaceItems(List=vectors_2, Item=number_slider_8, Indices=item_index_2, Wrap=False)  # disabled
heatmap_2 = LBSpatialHeatmap(values=replace_items_2, mesh=genpts_2.mesh, legend_title=panel_11, global_title=panel_10)  # -> mesh, legend, title, colors, legend_par, vis_set; disabled; plug-in component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
panel_13 = Panel(replace_items_2)  # disabled

data_2 = Data(replace_items_2)  # disabled
bnd_2 = Bounds(Numbers=data_2)  # disabled
dedomain_2 = DeconstructDomain(Domain=bnd_2)  # -> Start, End; disabled
gradient_2 = Gradient(
    LowerLimit=dedomain_2.Start,
    UpperLimit=dedomain_2.End,
    Parameter=data_2,
    stops=[0.103: RGB(0, 0, 255), 0.22: RGB(0, 170, 255), 0.305: RGB(0, 255, 255), 0.398: RGB(0, 255, 188), 0.504: RGB(0, 255, 106), 0.605: RGB(91, 255, 0), 0.699: RGB(184, 255, 0), 0.799: RGB(255, 255, 0), 0.898: RGB(255, 170, 0)])  # disabled
vector_display_ex_2 = VectorDisplayEx(Point=points_2, Vector=vectors_2, Colour=gradient_2, Width=number_slider_9)  # disabled
